# Grasshopper definition AudioTerrain.gh (Grasshopper 1.0.8)
# plug-ins: RhinoCodePluginGH

# ---- group: FFT Processing / Audio Processing Inputs
interpolation_points = Slider(0, range=0..100)
pole_to_pole_faces = Slider(125, range=0..500)
# Input m and n to script. Take values from data in time range and make n lists that are  m-1 long.
# 
# Organize lists instead so that there are m-1 lists n long (i.e. transpose matrix).
# 
# Merge lists into 1 dimension.
# 
# Send values out to transform sphere.
# There are m+1 vertices in a slice. Align slice values with these vertices.
# 
# There are n vertices in a circle (time range).
equatorial_faces = Slider(125, range=0..500)
max_frequencies = Slider(0, range=0..100)
gaussian_sigma = Slider(2, range=1..10)
sr_divider = Slider(2, range=1..15)
start_index = Slider(0, range=0..150)
file_path = FilePath("C:\Users\Noah\Downloads\Destroyer of Worlds.wav")

# ---- group: FFT Processing
python_3_script = Python3Script(
    filepath=file_path,
    sr_divider=sr_divider,
    start_index=start_index,
    num_max=max_frequencies,
    sigma=gaussian_sigma,
    interpoints=interpolation_points,
    m=pole_to_pole_faces,
    n=equatorial_faces)  # -> out, plane_freq, sphere_freq; inputs start_index: Int32, num_max: Int32, interpoints: Int32, m: Int32, n: Int32
# ---------- python_3_script: Python ----------
"""
    Audio Processing for Grasshopper
    Author: Noah James

    Inputs:
        filepath -- audio file path (string)
        sr_divider -- divides the sample rate (int)
        start_index -- index for starting sample in seconds (int)
        num_max -- number of maximum frequencies to keep (int)
        sigma -- size of Gaussian filter (int)
        interpoints -- number of time steps to interpolate (int)
        m -- size of mesh in the x/phi dimension (int)
        n -- size of mesh in the z/theta dimension (int)

    Outputs:
        plane_freq: values for planar mesh (list(float))
        sphere_freq: values for spherical mesh (list(float))
"""


# --------------------------------
# Import packages
# --------------------------------
# venv: site-packages
import numpy as np
from scipy.io import wavfile
from scipy.fft import rfft, rfftfreq
from scipy.ndimage.filters import gaussian_filter


# --------------------------------
# Read data and set globabls
# --------------------------------
SAMPLERATE, data = wavfile.read(filepath)
WINDOW_SIZE = int(SAMPLERATE // sr_divider)
start = start_index * SAMPLERATE


# --------------------------------
# Run FFT and process frequencies into matrix
# --------------------------------
displacements = np.empty([n, m-1])
for j in range(n - interpoints):
    # call FFT to get frequencies + amplitudes for current window
    f = np.abs(rfft(data[start+(j*WINDOW_SIZE):start+((j+1)*WINDOW_SIZE), 0]))
    i = f.argsort()[-num_max:]

    for k in range(m-1):
        if k not in i:
            # zero the non-max frequencies if num_max >= 1
            displacements[j, k] = 0
        else:
            # set to kth frequency value from time step j
            displacements[j, k] = f[k]



# --------------------------------
# Interpolate final time steps towards first time step
# --------------------------------
# get np.linspace between finish and start points
x = np.linspace(0.0, 1.0, interpoints+2)[1:-1]

# Perform interpolations
for k in range(m-1):
    y = [displacements[n-interpoints-1, k], displacements[0,k]]
    displacements[n-interpoints:n, k] = np.interp(x, [0.0, 1.0], y)


# --------------------------------
# Final preprocessing
# --------------------------------
# Gaussian blur on matrix
displacements = gaussian_filter(displacements, sigma=sigma)

# transpose then flatten to match sphere mesh
sphere_freq = list(np.transpose(displacements).flatten())

# add sphere poles as max of neighbors
first_pole = np.max(sphere_freq[1:n])
last_pole = np.max(sphere_freq[-n:-1])
sphere_freq.insert(0, first_pole)
sphere_freq.append(last_pole)

# planar terrain output
plane_freq = list(displacements.flatten())
# ---------- end python_3_script ----------

# ---- group: Plane Mesh
mesh_plane = MeshPlane(
    Boundary={Plane=PlaneXY(0, 0, 0), Size=Domain2(u=-10..10, v=-10..10)},
    WidthCount=pole_to_pole_faces,
    HeightCount=equatorial_faces)  # -> Mesh, Area
deconstruct_mesh = DeconstructMesh(Mesh=mesh_plane.Mesh)  # -> Vertices, Faces, Colours, Normals
deconstruct = Deconstruct(Point=deconstruct_mesh.Vertices)  # -> XComponent, YComponent, ZComponent
expression = Expression(p1=deconstruct.ZComponent, p2=python_3_script.plane_freq, Expression="(p1 + p2)")
construct_domain = ConstructDomain(DomainStart=Slider(0, range=0..100), DomainEnd=Slider(1000000, range=1..1000000))
construct_domain_2 = ConstructDomain(DomainStart=Slider(7.543, range=0..50), DomainEnd=Slider(5, range=0..100))
remap_numbers = RemapNumbers(Value=expression, Source=construct_domain, Target=construct_domain_2)  # -> Mapped, Clipped
construct_point = ConstructPoint(XCoordinate=deconstruct.XComponent, YCoordinate=deconstruct.YComponent, ZCoordinate=remap_numbers.Clipped)
patch = Patch(Points=construct_point, Spans=Slider(50, range=0..100), Flexibility=Slider(1, range=0..100), Trim=True)

# ---- group: Sphere Mesh
mesh_sphere = MeshSphere(Base=PlaneXY(0, 0, 0), Radius=10, UCount=pole_to_pole_faces, VCount=equatorial_faces)
deconstruct_mesh_2 = DeconstructMesh(Mesh=mesh_sphere)  # -> Vertices, Faces, Colours, Normals
to_polar = ToPolar(Point=deconstruct_mesh_2.Vertices, System=PlaneXY(0, 0, 0))  # -> Phi, Theta, Radius
expression_2 = Expression(p1=python_3_script.sphere_freq, p2=to_polar.Radius, Expression="(p1 + p2)")
construct_domain_3 = ConstructDomain(DomainStart=Slider(50, range=0..50), DomainEnd=Slider(59.391, range=0..100))
construct_domain_4 = ConstructDomain(DomainStart=Slider(0, range=0..100), DomainEnd=Slider(1000000, range=1..1000000))
remap_numbers_2 = RemapNumbers(Value=expression_2, Source=construct_domain_4, Target=construct_domain_3)  # -> Mapped, Clipped
point_polar = PointPolar(BasePlane=PlaneXY(0, 0, 0), XYAngle=to_polar.Phi, ZAngle=to_polar.Theta, Offset=remap_numbers_2.Clipped)
construct_mesh = ConstructMesh(Vertices=point_polar, Faces=deconstruct_mesh_2.Faces)

# ---- group: Base Creation
scale = Scale(Geometry=patch, Center=Point(0, 0, 0), Factor=Slider(4, range=1..4))  # -> Geometry, Transform
unit_x = UnitX(Factor=Slider(155, range=0..1000))
unit_z = UnitZ(Factor=Slider(-77, range=-100..0))
move = Move(Geometry=scale.Geometry, Motion=unit_x)  # -> Geometry, Transform
extrude = Extrude(Base=move.Geometry, Direction=unit_z)
bounding_box = BoundingBox(Content=extrude, Plane=PlaneXY(0, 0, 0))  # -> Box, Box_2
deconstruct_box = DeconstructBox(Box=bounding_box.Box)  # -> Plane, X, Y, Z
deconstruct_domain = DeconstructDomain(Domain=deconstruct_box.Z)  # -> Start, End
subtraction = Subtraction(A=deconstruct_domain.Start, B=deconstruct_domain.End)
construct_point_2 = ConstructPoint(XCoordinate=0, YCoordinate=0, ZCoordinate=subtraction)
xy_plane = XYPlane(Origin=construct_point_2)
move_to_plane = MoveToPlane(Geometry=bounding_box.Box, Plane=xy_plane, Above=True, Below=True)  # -> Geometry, Transform
solid_intersection = SolidIntersection(BrepsA=move_to_plane.Geometry, BrepsB=extrude)

# ---- group: Object Transformations
move_to_plane_2 = MoveToPlane(Geometry=construct_mesh, Plane=PlaneXY(0, 0, 0), Above=True, Below=True)  # -> Geometry, Transform
rotate_axis = RotateAxis(Geometry=solid_intersection, Angle=3.141592654, Axis=Line((0, 0, 0), (10, 0, 0)))  # -> Geometry, Transform
mesh_join = MeshJoin(Meshes=[move_to_plane_2.Geometry, rotate_axis.Geometry])
