# Grasshopper definition ParametricDesignSlicer.gh (Grasshopper 1.0.8)
# plug-ins: RhinoCodePluginGH

polygon_count = Slider(5, range=0..10)
random_seed = Slider(-1000000, range=-1000000..1000000)
polygon_displacement = Slider(10, range=0..10)
python_3_script = Python3Script(seed=random_seed, count=polygon_count)  # -> out, radius, segments, fillet_radius; inputs count: Int32
# ---------- python_3_script: Python ----------
"""Grasshopper Script"""
a = "Hello Python 3 in Grasshopper!"
print(a)

import random

random.seed(seed)

radius = []
segments = []
fillet_radius = []

for i in range(count):
    radius.append(random.uniform(10.0, 15.0))
    segments.append(random.randint(3, 10))
    fillet_radius.append(random.uniform(0.0, 7.5))
# ---------- end python_3_script ----------
material_thickness = Slider(4, range=0..10)
cutout_size = Slider(0.348, range=0..1)
series = Series(Start=0, Step=polygon_displacement, Count=polygon_count)

# ---- group: Polygon Tower
polygon = Polygon(
    Plane=PlaneXY(0, 0, 0),
    Radius=python_3_script.radius,
    Segments=python_3_script.segments,
    FilletRadius=python_3_script.fillet_radius)  # -> Polygon, Length
vector_xyz = VectorXYZ(XComponent=0, YComponent=0, ZComponent=series)  # -> Vector, Length
move = Move(Geometry=polygon.Polygon, Motion=vector_xyz.Vector)  # -> Geometry, Transform
loft = Loft(Curves=move.Geometry, Options={Adjust=False, Closed=False, LoftEnds=0, LoftSimp=0, LoftType=0, Rebuild=10, Refit=0.01})
cap_holes = CapHoles(Brep=loft)

# ----
expression = Expression(x=python_3_script.radius, y=cutout_size, Expression="x * y")
panel = Panel(series)

# ---- group: Tower Cutout
circle = Circle(Plane=PlaneXY(0, 0, 0), Radius=expression)
vector_xyz_2 = VectorXYZ(XComponent=0, YComponent=0, ZComponent=expr("x+2", series))  # -> Vector, Length
move_2 = Move(Geometry=circle, Motion=vector_xyz_2.Vector)  # -> Geometry, Transform
loft_2 = Loft(Curves=move_2.Geometry, Options={Adjust=False, Closed=False, LoftEnds=0, LoftSimp=0, LoftType=0, Rebuild=10, Refit=0.01})
cap_holes_2 = CapHoles(Brep=loft_2)

# ----
construct_domain = ConstructDomain(DomainStart=expr("-x/2", "80"), DomainEnd=expr("x/2", "80"))
number_slider = Slider(2.25, range=0..20)
expression_2 = Expression(s=number_slider, x=polygon_count, y=polygon_displacement, z=material_thickness, Expression="((x - 1) * y) * s / z")
round = Round(Number=expression_2)  # -> Nearest, Floor, Ceiling
panel_2 = Panel(round.Floor)
series_2 = Series(Start=0, Step=material_thickness, Count=round.Floor)
construct_point = ConstructPoint(XCoordinate=0, YCoordinate=0, ZCoordinate=series_2)
xy_plane = XYPlane(Origin=construct_point)
solid_difference = SolidDifference(BrepsA=cap_holes, BrepsB=cap_holes_2)
plane_surface = PlaneSurface(Plane=xy_plane, XSize=construct_domain, YSize=construct_domain)
scale = Scale(Geometry=solid_difference, Center=Point(0, 0, 0), Factor=number_slider)  # -> Geometry, Transform
brep = Brep(plane_surface)
brep_brep = BrepBrep(BrepA=scale.Geometry, BrepB=brep)  # -> Curves, Points
bounding_box = BoundingBox(Content=brep_brep.Curves, Plane=PlaneXY(0, 0, 0))  # -> Box, Box_2
unit_z = UnitZ(Factor=material_thickness)
deconstruct_box = DeconstructBox(Box=bounding_box.Box)  # -> Plane, X, Y, Z
extrude = Extrude(Base=brep_brep.Curves, Direction=unit_z)
panel_3 = Panel(brep_brep.Curves)
unflatten_tree = UnflattenTree(Tree=deconstruct_box.X, Guide=brep_brep.Curves)
python_3_script_2 = Python3Script(spacing=Slider(3, range=0..3), tree=brep_brep.Curves, step=material_thickness, box_sizes=unflatten_tree)  # -> out, curves, displacements, distances; inputs tree: tree, step: Double, box_sizes: tree
# ---------- python_3_script_2: Python ----------
"""
    Helper script for slicing
    - Moves slices onto XY plane
    - Spreads slices out along X-axis
"""

curves = []
displacements = []
distances = []

pre_len = 0.0
new_len = 0.0
pos = 0.0
updated_len = False
first_elem = True

for i in range(tree.BranchCount):
    branchList = tree.Branch(i)
    boxList = box_sizes.Branch(i)

    for j in range(branchList.Count):
        curves.append(branchList[j])
        displacements.append(-step * i)
        if branchList.Count > 1:
            new_len = max(boxList[0][1], boxList[1][1]);
            if not updated_len:
                pos += new_len
                pre_len = new_len
                updated_len = True
            distances.append(pos)
        elif first_elem:
            pre_len = boxList[0][1]
            distances.append(0.0)
            first_elem = False
        else:
            new_len = boxList[0][1]
            pos += new_len
            pre_len = new_len
            distances.append(pos)

    pos += pre_len + spacing
    updated_len = False

    print(i + 1)
# ---------- end python_3_script_2 ----------
panel_4 = Panel(python_3_script_2.out)
vector_xyz_3 = VectorXYZ(XComponent=python_3_script_2.distances, YComponent=0, ZComponent=0)  # -> Vector, Length
vector_xyz_4 = VectorXYZ(XComponent=0, YComponent=0, ZComponent=python_3_script_2.displacements)  # -> Vector, Length
construct_point_2 = ConstructPoint(XCoordinate="5", YCoordinate=0, ZCoordinate=0)
construct_point_3 = ConstructPoint(XCoordinate="-5", YCoordinate=0, ZCoordinate=0)
move_3 = Move(Geometry=python_3_script_2.curves, Motion=vector_xyz_4.Vector)  # -> Geometry, Transform
move_4 = Move(Geometry=move_3.Geometry, Motion=vector_xyz_3.Vector)  # -> Geometry, Transform
create_set = CreateSet(List=vector_xyz_3.Vector)  # -> Set, Map
line = Line(StartPoint=construct_point_3, EndPoint=construct_point_2)
move_5 = Move(Motion=create_set.Set)  # -> Geometry, Transform
transform = Transform(Geometry=line, Transform=move_5.Transform)
xy_plane_2 = XYPlane(Origin=Point(0, 0, 0))
text = Text(panel_4)
surface = Surface(xy_plane_2)
text_on_surface = TextOnSurface(
    Text=text,
    Font="Sans Bold:no Italic:no",
    Height=Slider(3.023, range=0..20),
    Depth=Slider(0, range=0..1),
    BaseLine=transform,
    BaseSurface=surface)
brep_edges = BrepEdges(Brep=text_on_surface)  # -> Naked, Interior, NonManifold
vector_xyz_5 = VectorXYZ(XComponent=Slider(-6.101, range=-50..50), YComponent=Slider(13.024, range=-50..50), ZComponent=0)  # -> Vector, Length
move_6 = Move(Geometry=brep_edges.Naked, Motion=vector_xyz_5.Vector)  # -> Geometry, Transform
