# Grasshopper definition VoronoiTable.gh (Grasshopper 1.0.8)
# plug-ins: Kangaroo2 Components

x_dimension = Slider(15, range=0..100)
y_dimension = Slider(20, range=0..100)
rectangle = Rectangle(Plane=PlaneXY(0, 0, 0), XSize=x_dimension, YSize=y_dimension, Radius=0)  # -> Rectangle, Length
unit_z = UnitZ(Factor=Slider(10, range=0..100))
vector_xyz = VectorXYZ(XComponent=0, YComponent=0, ZComponent=Slider(0, range=-10..10))  # -> Vector, Length
area = Area(Geometry=rectangle.Rectangle)  # -> Area, Centroid
extrude = Extrude(Base=rectangle.Rectangle, Direction=unit_z)
number_slider = Slider(0.9, range=0..2)
number_slider_2 = Slider(0.9, range=0..2)
vector_2pt = Vector2Pt(PointA=vector_xyz.Vector, PointB=area.Centroid, Unitize=False)  # -> Vector, Length
expression = Expression(x1=x_dimension, x2=number_slider, Expression="(1-x2) * x1")
expression_2 = Expression(y1=y_dimension, y2=number_slider_2, Expression="(1-y2) * y1")
circle = Circle(Plane=PlaneXY(0, 0, 0), Radius=Slider(2, range=0..10))
circle_2 = Circle(Plane=PlaneXY(0, 0, 0), Radius=1)
vector_xyz_2 = VectorXYZ(XComponent=Slider(0, range=-100..100), YComponent=Slider(-25, range=-100..100), ZComponent=Slider(-50, range=-100..100))  # -> Vector, Length
cap_holes = CapHoles(Brep=extrude)
unit_z_2 = UnitZ(Factor=Slider(5.5, range=0..10))
scale_nu = ScaleNU(Geometry=cap_holes, Plane=PlaneXY(0, 0, 0), ScaleX=number_slider, ScaleY=number_slider_2, ScaleZ=Slider(0.9, range=0..2))  # -> Geometry, Transform
scale_nu_2 = ScaleNU(Geometry=cap_holes, Plane=PlaneXY(0, 0, 0), ScaleX=1, ScaleY=1, ScaleZ=expr("x/10", Slider(8.5, range=0..10)))  # -> Geometry, Transform
vector_xyz_3 = VectorXYZ(XComponent=expr("x/2", expression), YComponent=expr("x/2", expression_2), ZComponent=0)  # -> Vector, Length
move = Move(Geometry=area.Centroid, Motion=vector_xyz_2.Vector)  # -> Geometry, Transform
move_2 = Move(Geometry=circle, Motion=unit_z_2)  # -> Geometry, Transform
move_3 = Move(Geometry=[circle_2, move_2.Geometry], Motion=vector_2pt.Vector)  # -> Geometry, Transform
populate_3d = Populate3D(Region=cap_holes, Count=Slider(250, range=0..500), Seed=1)
multiplication = Multiplication(A=unit_z, B=Slider(0.85, range=0..1))
move_4 = Move(Geometry=scale_nu.Geometry, Motion=vector_xyz_3.Vector)  # -> Geometry, Transform
unit_z_3 = UnitZ(Factor=1)
deconstruct_brep = DeconstructBrep(Brep=move_4.Geometry)  # -> Faces, Edges, Vertices
move_5 = Move(Geometry=rectangle.Rectangle, Motion=multiplication)  # -> Geometry, Transform
move_6 = Move(Geometry=rectangle.Rectangle, Motion=expr("x*0.95", unit_z))  # -> Geometry, Transform
voronoi_3d = Voronoi3D(Points=populate_3d)  # -> Cells, Boundary
area_2 = Area(Geometry=deconstruct_brep.Faces)  # -> Area, simplify(Centroid)
line_sdl = LineSDL(Start=move.Geometry, Direction=unit_z_3, Length=Slider(100, range=-100..100))
populate_3d_2 = Populate3D(Region=move_4.Geometry, Count=Slider(3, range=0..500), Seed=Slider(32, range=0..500), Points=area_2.Centroid)  # -> simplify(Population)
point = Point(flatten([area_2.Centroid, populate_3d_2]))
area_3 = Area(Geometry=voronoi_3d.Cells)  # -> Area, Centroid
point_on_curve = PointOnCurve(line_sdl, parameter=1)
voronoi_3d_2 = Voronoi3D(Points=point)  # -> Cells, Boundary
distance = Distance(PointA=point_on_curve, PointB=area_3.Centroid)
brep_edges = BrepEdges(Brep=voronoi_3d_2.Cells)  # -> Naked, Interior, NonManifold
construct_domain = ConstructDomain(DomainStart=Slider(0.8, range=0..1), DomainEnd=Slider(1, range=0..1))
bounds = Bounds(Numbers=distance)
remap_numbers = RemapNumbers(Value=distance, Source=bounds, Target=construct_domain)  # -> Mapped, Clipped
scale = Scale(Geometry=voronoi_3d.Cells, Center=area_3.Centroid, Factor=remap_numbers.Mapped)  # -> Geometry, Transform
multipipe = MultiPipe(
    Curves=brep_edges.Interior,
    NodeSize=0.5,
    EndOffset=1,
    StrutSize=Slider(0.6, range=0..10),
    Segment=0,
    KinkAngle=0.6,
    CubeFit=0,
    Caps=0)
loft = Loft(
    Curves=[move_3.Geometry, move_5.Geometry, move_6.Geometry],
    Options={Adjust=True, Closed=False, LoftEnds=0, LoftSimp=0, LoftType=2, Rebuild=10, Refit=0.01})
mesh_difference = MeshDifference(MeshesA=scale.Geometry, MeshesB=scale_nu_2.Geometry)
face_boundaries = FaceBoundaries(Mesh=mesh_difference)
cap_holes_2 = CapHoles(Brep=loft)
boundary_surfaces = BoundarySurfaces(Edges=face_boundaries)
brep_join = BrepJoin(Breps=boundary_surfaces)  # -> Breps, Closed
solid_union = SolidUnion(Breps=[multipipe, brep_join.Breps, cap_holes_2])
solid_intersection = SolidIntersection(BrepsA=solid_union, BrepsB=cap_holes)
